# Grasshopper definition schema.gh (Grasshopper 1.0.7)
# plug-ins: jSwan

number_slider = Slider(1, range=0..1)
serialize_json = SerializeJson(
    Name="ducttype1",
    Shape="rectangular",
    Absolute_roughness=Slider(0.0001, range=0..1),
    Width=number_slider,
    Height=number_slider,
    IncludeNullAndEmptyProperties=False)
serialize_json_2 = SerializeJson(
    Name="ducttype2",
    Shape="round",
    Absolute_roughness=Slider(0.0001, range=0..1),
    Diameter=Slider(1, range=0..1),
    IncludeNullAndEmptyProperties=False)
serialize_json_3 = SerializeJson(
    Name="duct2",
    Duct_type="ducttype2",
    Length=Slider(30, range=0..100),
    Flowrate=Slider(0.5, range=0..1),
    IncludeNullAndEmptyProperties=False)
serialize_json_4 = SerializeJson(
    Name="duct1",
    Duct_type="ducttype1",
    Length=Slider(10, range=0..10),
    Flowrate=Slider(0.5, range=0..1),
    IncludeNullAndEmptyProperties=False)
serialize_json_5 = SerializeJson(RigidDuctType=[serialize_json, serialize_json_2], IncludeNullAndEmptyProperties=False)
serialize_json_6 = SerializeJson(RigidDuctType=[serialize_json_4, serialize_json_3], IncludeNullAndEmptyProperties=False)
serialize_json_7 = SerializeJson(IncludeNullAndEmptyProperties=False)
serialize_json_8 = SerializeJson(IncludeNullAndEmptyProperties=False)
serialize_json_9 = SerializeJson(RigidDuct=[serialize_json_5, serialize_json_6, serialize_json_7, serialize_json_8], IncludeNullAndEmptyProperties=False)
panel = Panel(serialize_json_9)
deserialize_json = DeserializeJson(JSON=serialize_json_9, OutputsLocked=False)
deserialize_json_2 = DeserializeJson(JSON=deserialize_json, OutputsLocked=False)  # -> RigidDuctType, RigidDuct
deserialize_json_3 = DeserializeJson(JSON=deserialize_json_2.RigidDuctType, OutputsLocked=False)  # -> Name, Shape, Absolute_roughness, Width, Height, Diameter
deserialize_json_4 = DeserializeJson(JSON=deserialize_json_2.RigidDuct, OutputsLocked=False)  # -> Name, Duct_type, Length, Flowrate
